# Dynamo graph areaChart.dyn (Dynamo 1.1.0.2094)

file_path = Filename("E:\Google Drive\Work\Mandrill\DynamoSamples\SampleDataCSV\AreaChart.csv")
dataFromCSV = Charts.AreaChart.DataFromCSV(file_path)
colourUI = nColorPicker()
code_block = CodeBlock { 1800; 800; }
style = Charts.AreaChart.Style(colourUI, code_block.out0, code_block.out1)
chart = Charts.AreaChart.Chart(dataFromCSV, style)
create_row_container = MandrillRowContainerNode(chart)
create_report = MandrillReportNode(create_row_container)
report_window = MandrillWindowNodeModel(create_report)
pdf_size = pdf_SizeUI("Letter11x17")
pdf_orientation = pdf_OrientationUI("Landscape")
pdf_fit_mode = pdf_FitModeUI("AutoFit")
code_block_2 = CodeBlock { 0; }
PDFStyle = Report.Pdf.PDFStyle(pdf_size, pdf_orientation, pdf_fit_mode, pdf_fit_mode, code_block_2)
file_path_2 = Filename("E:\Google Drive\Presentations_Workshops\2016 - AIA Presentation\JPG\areaChartExport.pdf")
saveAsPDF = Report.Pdf.SaveAsPDF(arg1=PDFStyle, arg2=file_path_2)
