# Dynamo graph gridsterBarChart1.dyn (Dynamo 1.2.0.2654)

file_path = Filename("..\AreaChart\AreaChart.csv")
code_block = CodeBlock { 0; 700; }
domain = Charts.MiscNodes.Domain(code_block.out0, code_block.out1)
dataFromCSV = Charts.AreaChart.DataFromCSV(file_path, domain)
color_picker = nColorPicker()
code_block_2 = CodeBlock { 1; 1; }
address = Charts.MiscNodes.Address(code_block_2.out0, code_block_2.out1)
code_block_3 = CodeBlock { 600; 300; }
code_block_4 = CodeBlock { 4; }
style = Charts.AreaChart.Style(color_picker, address, code_block_3.out0, code_block_3.out1, arg5=code_block_4)
chart = Charts.AreaChart.Chart(dataFromCSV, style)
file_path_2 = Filename("..\..\_Logo\mandrillLogo1-01.png")
code_block_5 = CodeBlock { 1; 1; }
address_2 = Charts.MiscNodes.Address(code_block_5.out0, code_block_5.out1)
code_block_6 = CodeBlock { 400; 100; }
style_2 = Image.Image.Style(address_2, code_block_6.out0, code_block_6.out1)
create = Image.Image.Create(file_path_2, style_2)
file_path_3 = Filename("..\..\_Logo\mandrillLogo-01.png")
code_block_7 = CodeBlock { 2; 2; }
address_3 = Charts.MiscNodes.Address(code_block_7.out0, code_block_7.out1)
code_block_8 = CodeBlock { 100; 100; }
code_block_9 = CodeBlock { "asd"; }
style_3 = Image.Image.Style(address_3, code_block_8.out0, code_block_8.out1, code_block_9)
create_2 = Image.Image.Create(file_path_3, style_3)
code_block_10 = CodeBlock { "Mandrill is a super dooper plug-in"; }
color_picker_2 = nColorPicker()
code_block_11 = CodeBlock { 3; 2; }
address_4 = Charts.MiscNodes.Address(code_block_11.out0, code_block_11.out1)
code_block_12 = CodeBlock { 400; 100; 24; }
font_weight = tn_FontWeight("bold")
font_style = tn_FontStyle("normal")
font_transform = tn_FontTransform("none")
style_4 = Text.Text.Style(color_picker_2, address_4, code_block_12.out0, code_block_12.out1, code_block_12.out2, font_weight, font_style, font_transform)
create_3 = Text.Text.Create(code_block_10, style_4)
code_block_13 = CodeBlock { "No shit!"; }
code_block_14 = CodeBlock { 200; }
style_5 = Text.Text.Style(color_picker_2, address_4, code_block_14, code_block_12.out1, code_block_12.out2, font_weight, font_style, font_transform)
create_4 = Text.Text.Create(code_block_13, style_5)
file_path_4 = Filename("E:\Google Drive\Work\Mandrill\_DynamoSamples\BarChart\Level1.csv")
code_block_15 = CodeBlock { 0; 26; }
domain_2 = Charts.MiscNodes.Domain(code_block_15.out0, code_block_15.out1)
dataFromCSV_2 = Charts.BarChart.DataFromCSV(file_path_4, domain_2)
color_picker_3 = nColorPicker()
color_picker_4 = nColorPicker()
code_block_16 = CodeBlock { 1; 1; }
address_5 = Charts.MiscNodes.Address(code_block_16.out0, code_block_16.out1)
code_block_17 = CodeBlock { 800; 400; 13; }
boolean = BoolSelector(true)
style_6 = Charts.BarChart.Style(color_picker_3, color_picker_4, address_5, code_block_17.out0, code_block_17.out1, arg6=code_block_17.out2, arg7=boolean)
chart_2 = Charts.BarChart.Chart(dataFromCSV_2, style_6)
dataFromCSV_3 = Charts.DonutChart.DataFromCSV(file_path_4)
color_picker_5 = nColorPicker()
code_block_18 = CodeBlock { null; }
code_block_19 = CodeBlock { 11; 4; }
address_6 = Charts.MiscNodes.Address(code_block_19.out0, code_block_19.out1)
integer_slider = IntegerSlider(577, range=1..1000 step 1)
integer_slider_2 = IntegerSlider(40, range=1..100 step 1)
boolean_2 = BoolSelector(true)
boolean_3 = BoolSelector(true)
code_block_20 = CodeBlock { "Label"; }
style_7 = Charts.DonutChart.Style(color_picker_5, code_block_18, address_6, integer_slider, integer_slider_2, boolean_2, boolean_3, code_block_20)
chart_3 = Charts.DonutChart.Chart(dataFromCSV_3, style_7)
create_report = MandrillReportNode(chart_2, chart_3)
report_window = MandrillWindowNodeModel(create_report)
