# Dynamo graph donutChartSample.dyn (Dynamo 1.1.0.2094)

readFromFile = CSV.ReadFromFile()
code_block = CodeBlock { 1; }
dropItems = List.DropItems(list=readFromFile, amount=code_block)
transpose = List.Transpose(dropItems)
code_block_2 = CodeBlock(IN=transpose) { names = IN[0]; values = IN[1]; }
data = Charts.DonutChart.Data(code_block_2.names, code_block_2.values)
file_path = Filename(".\donutChartData.csv")
fromPath = FileObject(file_path)  # "File.FromPath"
dataFromCSV = Charts.DonutChart.DataFromCSV(fromPath)
code_block_3 = CodeBlock()
# ---------- code_block_3.designscript (6 lines) ----------
{"Sample Data 1",
"Sample Data 2",
"Sample Data 3",
"Sample Data 4",
"Sample Data 5"};
{1000,100,200,100,100};
# ----------------------------------------
data_2 = Charts.DonutChart.Data(code_block_3.out0, code_block_3.out1)
code_block_4 = CodeBlock { DSCore.Color.ByARGB(1,250,180,20); }
number_slider = DoubleSlider(1000, range=100..1000 step 1)
number_slider_2 = DoubleSlider(500, range=100..1000 step 1)
boolean = BoolSelector(true)
boolean_2 = BoolSelector(true)
style = Charts.DonutChart.Style(code_block_4, arg2=number_slider, arg3=number_slider_2, arg4=boolean, arg5=boolean_2)
chart = Charts.DonutChart.Chart(data_2, style)
create_row_container = MandrillRowContainerNode(chart)
create_report = MandrillReportNode(create_row_container)
report_window = MandrillWindowNodeModel(create_report)
pdf_size = pdf_SizeUI("ArchD")
pdf_orientation = pdf_OrientationUI("Landscape")
pdf_fit_mode = pdf_FitModeUI("NoAdjustment")
code_block_5 = CodeBlock { 0; }
PDFStyle = Report.Pdf.PDFStyle(pdf_size, pdf_orientation, pdf_fit_mode, pdf_fit_mode, code_block_5)
file_path_2 = Filename("C:\Users\ksobon\Desktop\donutChart.pdf")
saveAsPDF = Report.Pdf.SaveAsPDF(arg1=PDFStyle, arg2=file_path_2)
code_block_6 = CodeBlock { Color.ByARGB(1,50,50,50); }
code_block_7 = CodeBlock { null; }
code_block_8 = CodeBlock()
# ---------- code_block_8.designscript (5 lines) ----------
{Color.ByARGB(1,50,50,50),
Color.ByARGB(1,100,100,100),
Color.ByARGB(1,150,150,150),
Color.ByARGB(1,200,200,200),
Color.ByARGB(1,250,250,250)};
# ----------------------------------------
