# Dynamo graph GroupedBarChart_01.dyn (Dynamo 1.1.0.2094)

code_block = CodeBlock { "Wall Types used per Floor"; }
code_block_2 = CodeBlock { 40; }
font_weight = tn_FontWeight("bold")
style = Text.Text.Style(arg1=code_block_2, arg2=font_weight)
create = Text.Text.Create(code_block, style)
create_row_container = MandrillRowContainerNode(create)
file_path = Filename("..\..\..\..\Presentations_Workshops\2016%20-%20ACADIA\Day%2002%20Files\05_MandrillExampleWallTypes\WallTypeData.csv")
fromPath = FileObject(file_path)  # "File.FromPath"
code_block_3 = CodeBlock { 0; }
integer_slider = IntegerSlider(30, range=0..50 step 5)
domain = Charts.MiscNodes.Domain(code_block_3, integer_slider)
dataFromCSV = Charts.GroupedBarChart.DataFromCSV(fromPath, domain)
code_block_4 = CodeBlock { null; }
integer_slider_2 = IntegerSlider(1800, range=1..2000 step 1)
integer_slider_3 = IntegerSlider(600, range=1..2000 step 1)
code_block_5 = CodeBlock { "Count per Floor"; }
style_2 = Charts.GroupedBarChart.Style(code_block_4, integer_slider_2, integer_slider_3, code_block_5)
chart = Charts.GroupedBarChart.Chart(dataFromCSV, style_2)
create_row_container_2 = MandrillRowContainerNode(chart)
create_report = MandrillReportNode(create_row_container, create_row_container_2)
report_window = MandrillWindowNodeModel(create_report)
pdf_size = pdf_SizeUI("Letter11x17")
pdf_orientation = pdf_OrientationUI("Landscape")
pdf_fit_mode = pdf_FitModeUI("NoAdjustment")
PDFStyle = Report.Pdf.PDFStyle(pdf_size, pdf_orientation, pdf_fit_mode, pdf_fit_mode)
file_path_2 = Filename("C:\Users\ksobon\Desktop\test.pdf")
saveAsPDF = Report.Pdf.SaveAsPDF(arg1=PDFStyle, arg2=file_path_2)
