# Dynamo graph scatterPlotMatrixData.dyn (Dynamo 1.2.0.2654)

file_path = Filename("E:\Google Drive\Work\Mandrill\_DynamoSamples\ScaterPlotMatrix\scatterPlotMatrixData.csv")
dataFromCSV = Charts.ScatterPlotMatrix.DataFromCSV(file_path)
integer_slider = IntegerSlider(5, range=1..20 step 1)
integer_slider_2 = IntegerSlider(1, range=1..20 step 1)
address = Charts.MiscNodes.Address(integer_slider, integer_slider_2)
integer_slider_3 = IntegerSlider(800, range=1..1000 step 1)
style = Charts.ScatterPlotMatrix.Style(arg1=address, arg2=integer_slider_3)
chart = Charts.ScatterPlotMatrix.Chart(dataFromCSV, style)
file_path_2 = Filename("..\BarChart\barChartData.csv")
code_block = CodeBlock { 40; }
domain = Charts.MiscNodes.Domain(arg1=code_block)
dataFromCSV_2 = Charts.BarChart.DataFromCSV(file_path_2, domain)
code_block_2 = CodeBlock { 3; }
style_2 = Charts.BarChart.Style(arg6=code_block_2)
chart_2 = Charts.BarChart.Chart(dataFromCSV_2, style_2)
create_report = MandrillReportNode(chart, chart_2)
report_window = MandrillWindowNodeModel(create_report)
