# Dynamo graph StackedBarChart_01.dyn (Dynamo 1.1.0.2094)

file_path = Filename("..\..\..\..\Presentations_Workshops\2016%20-%20ACADIA\Day%2002%20Files\05_MandrillExampleWallTypes\WallTypeData.csv")
fromPath = FileObject(file_path)  # "File.FromPath"
code_block = CodeBlock { 0; }
integer_slider = IntegerSlider(50, range=0..50 step 5)
domain = Charts.MiscNodes.Domain(code_block, integer_slider)
dataFromCSV = Charts.StackedBarChart.DataFromCSV(fromPath, domain)
code_block_2 = CodeBlock { null; }
integer_slider_2 = IntegerSlider(1800, range=1..2000 step 1)
integer_slider_3 = IntegerSlider(800, range=1..2000 step 1)
code_block_3 = CodeBlock { "Count per Floor"; }
style = Charts.StackedBarChart.Style(arg1=code_block_2, arg2=integer_slider_2, arg3=integer_slider_3, arg4=code_block_3)
chart = Charts.StackedBarChart.Chart(dataFromCSV, style)
create_row_container = MandrillRowContainerNode(chart)
create_report = MandrillReportNode(create_row_container)
report_window = MandrillWindowNodeModel(create_report)
pdf_size = pdf_SizeUI("Letter11x17")
pdf_orientation = pdf_OrientationUI("Landscape")
pdf_fit_mode = pdf_FitModeUI("AutoFit")
PDFStyle = Report.Pdf.PDFStyle(pdf_size, pdf_orientation, pdf_fit_mode, pdf_fit_mode)
file_path_2 = Filename("C:\Users\ksobon\Desktop\test.pdf")
saveAsPDF = Report.Pdf.SaveAsPDF(arg1=PDFStyle, arg2=file_path_2)
