# Dynamo graph areaChart.dyn (Dynamo 1.2.0.2690)

file_path = Filename(".\AreaChart.csv")
code_block = CodeBlock { 0; 650; }
domain = Charts.MiscNodes.Domain(code_block.out0, code_block.out1)
dataFromCSV = Charts.AreaChart.DataFromCSV(file_path, domain)
color_picker = nColorPicker()
code_block_2 = CodeBlock { 3; 1; }
address = Charts.MiscNodes.Address(code_block_2.out0, code_block_2.out1)
integer_slider = IntegerSlider(10, range=0..100 step 1)
integer_slider_2 = IntegerSlider(20, range=0..100 step 1)
margins = Charts.MiscNodes.Margins(integer_slider, integer_slider, integer_slider_2, integer_slider_2)
code_block_3 = CodeBlock { 1400; 600; "Label"; 10; }
style = Charts.AreaChart.Style(color_picker, address, margins, code_block_3.out0, code_block_3.out1, code_block_3.out2, code_block_3.out3)
chart = Charts.AreaChart.Chart(dataFromCSV, style)
create_report = MandrillReportNode(chart)
report_window = MandrillWindowNodeModel(create_report)
code_block_4 = CodeBlock { {"A","B","C","D","E"}; {1,12,13,1,15}; }
code_block_5 = CodeBlock { 0; 16; }
domain_2 = Charts.MiscNodes.Domain(code_block_5.out0, code_block_5.out1)
data = Charts.AreaChart.Data(code_block_4.out0, code_block_4.out1, domain_2)
code_block_6 = CodeBlock { 1400; 600; "Label"; 4; }
style_2 = Charts.AreaChart.Style(arg3=code_block_6.out0, arg4=code_block_6.out1, arg5=code_block_6.out2, arg6=code_block_6.out3)
chart_2 = Charts.AreaChart.Chart(data, style_2)
create_report_2 = MandrillReportNode(chart_2)
report_window_2 = MandrillWindowNodeModel(create_report_2)
